# Grasshopper definition esdudoDeMassas01.gh (Grasshopper 0.9.76)
# plug-ins: LunchBox

# BAKE
# TERRENO
boolean_toggle = BooleanToggle(False)
# MASSA 01
number_slider = Slider(3, range=0..10)
# MASSA 02
number_slider_2 = Slider(17.4, range=0..100)
curve = Curve(<curve referenced from the Rhino model>)
curve_2 = Curve(<curve referenced from the Rhino model>)
unit_z = UnitZ(Factor=Slider(15, range=0..100))
unit_z_2 = UnitZ(Factor=number_slider)
unit_z_3 = UnitZ(Factor=number_slider_2)
curve_3 = Curve(<curve referenced from the Rhino model>)
curve_4 = Curve(<curve referenced from the Rhino model>)
curve_5 = Curve(<curve referenced from the Rhino model>)
move = Move(Geometry=curve_4, Motion=unit_z)  # -> Geometry, Transform
move_2 = Move(Geometry=curve_2, Motion=unit_z_2)  # -> Geometry, Transform
extrude = Extrude(Base=curve_5, Direction=unit_z_3)
merge = Merge(Data1=curve_3, Data2=move.Geometry)
cap_holes = CapHoles(Brep=extrude)
loft = Loft(Curves=merge, Options={Adjust=False, Closed=False, LoftEnds=0, LoftSimp=0, LoftType=0, Rebuild=10, Refit=0.01})
merge_2 = Merge(Data1=curve, Data2=move_2.Geometry)
cap_holes_2 = CapHoles(Brep=loft)
loft_2 = Loft(Curves=merge_2, Options={Adjust=False, Closed=False, LoftEnds=0, LoftSimp=0, LoftType=0, Rebuild=10, Refit=0.01})

colour_rgb = ColourRGB(Alpha=255, Red=Slider(200, range=0..255), Green=Slider(69, range=0..255), Blue=Slider(190, range=0..255))
object_bake = ObjectBake(
    BakeToggle=boolean_toggle,
    GeometryObjects=cap_holes,
    Layer="massa02",
    ObjectName="GH_Obj",
    ObjectColor=colour_rgb,
    LayerColor=colour_rgb)

colour_rgb_2 = ColourRGB(Alpha=255, Red=Slider(50, range=0..255), Green=Slider(249, range=0..255), Blue=Slider(50, range=0..255))
object_bake_2 = ObjectBake(
    BakeToggle=boolean_toggle,
    GeometryObjects=loft_2,
    Layer="Terreno",
    ObjectName="GH_Obj",
    ObjectColor=colour_rgb_2,
    LayerColor=colour_rgb_2)

colour_rgb_3 = ColourRGB(Alpha=255, Red=Slider(63, range=0..255), Green=Slider(190, range=0..255), Blue=Slider(190, range=0..255))
object_bake_3 = ObjectBake(
    BakeToggle=boolean_toggle,
    GeometryObjects=cap_holes_2,
    Layer="massa01",
    ObjectName="GH_Obj",
    ObjectColor=colour_rgb_3,
    LayerColor=colour_rgb_3)
