# Dynamo graph Home.dyn (Dynamo 2.10.1.3976)

code_block = CodeBlock { Point.ByCoordinates(0,0,0); }
sin = Math.Sin()  # unwired: angle
number_slider = DoubleSlider(0.9, range=0..100 step 0.1)
number_slider_2 = DoubleSlider(2.2, range=0..100 step 0.1)
number_slider_3 = DoubleSlider(1.7, range=0..100 step 0.1)
byCoordinates = Point.ByCoordinates(x=number_slider, y=number_slider_2, z=number_slider_3)
number_slider_4 = DoubleSlider(17.4, range=0..100 step 0.1)
number_slider_5 = DoubleSlider(11.6, range=0..100 step 0.1)
number_slider_6 = DoubleSlider(26.8, range=0..100 step 0.1)
# note: Design Scripts
byCoordinates_2 = Point.ByCoordinates(x=number_slider_4, y=number_slider_5, z=number_slider_6)
byStartPointEndPoint = Line.ByStartPointEndPoint(startPoint=byCoordinates, endPoint=byCoordinates_2)
code_block_2 = CodeBlock { Point.ByCoordinates(x,y,z); }  # unwired: x, y, z
